# Grasshopper definition Approximate Boundary Sent back.gh (Grasshopper 1.0.7)
# plug-ins: ClipperComponents, Human

# Reidentify Boundary for Open Curve Features (Eg: Wall)
# Input Unclosed Features
curve = Curve([<curve referenced from the Rhino model> x2])

# ---- group: More Accurate Boundary
divide_curve = DivideCurve(Curve=curve, Count=Slider(15, range=0..1000), Kinks=False)  # -> Points, Tangents, Parameters
shatter = Shatter(Curve=curve, Parameters=divide_curve.Parameters)

# ---- group: Find Approxmiate Boundary
bounding_box = BoundingBox(Content=shatter, Plane=PlaneXY(0, 0, 0))  # -> Box, Box_2
deconstruct_brep = DeconstructBrep(Brep=simplify(bounding_box.Box))  # -> Faces, Edges, Vertices
join_curves = JoinCurves(Curves=deconstruct_brep.Edges, Preserve=False)  # -> flatten(Curves)
number_slider = Slider(405, range=0..10000)
xy_plane = XYPlane(Origin=Point(0, 0, 0))
region_union = RegionUnion(Curves=<missing>, Plane=xy_plane)
geometry = Geometry(region_union)

# ----
custom_preview_lineweights = CustomPreviewLineweights(Geometry=curve, Shader=ColourSwatch(SwatchColor=RGB(0, 0, 0)), Thickness=Slider(8, range=0..10), Absolute=False)

number_slider_2 = Slider(0, range=0..10)
number_slider_3 = Slider(1, range=0..10)
# Distance of Polyline Offset can be used to control the scope of the approximate Boundary.
polyline_offset = PolylineOffset(
    Polylines=<missing>,
    Distance=<missing>,
    Plane=Plane(origin=(0, 0, 0), x=(0, 0, 0), y=(0, 0, 0)),
    Tolerance=0.01,
    ClosedFillet=<missing>,
    OpenFillet=<missing>,
    Miter=2)  # -> Contour, Holes

# ---- group: Tested Points
point = Point([<point referenced from the Rhino model> x16])

# ---- group: Test Weather the Point Features is Within the Approximate Boundary
point_in_curves = PointInCurves(Point=point, Curves=geometry)  # -> Relationship, Index, Point
equality = Equality(FirstNumber=point_in_curves.Relationship, SecondNumber=Slider(2, range=0..100))  # -> Equality, Inequality
cull_pattern = CullPattern(List=point_in_curves.Point, CullPattern=equality.Equality)
point_2 = Point(cull_pattern)

# ----
geometry_2 = Geometry(geometry)
panel = Panel("""50
150""")
dash_pattern = DashPattern(Curve=geometry_2, Pattern=panel)  # -> Dashes, Gaps
custom_preview_lineweights_2 = CustomPreviewLineweights(
    Geometry=dash_pattern.Dashes,
    Shader={diffuse=RGB(255, 105, 180), emission=RGB(76, 32, 54), shine=0.5, specular=RGB(255, 255, 255), transparency=0},
    Thickness=Slider(6, range=0..10),
    Absolute=False)

dot_display = DotDisplay(Point=point_2, Colour=ColourSwatch(SwatchColor=RGB(255, 152, 92)), Size=Slider(100, range=0..1000))
