# Grasshopper definition GH Definition.gh (Grasshopper 1.0.7)
# plug-ins: Caribou, Groundhog, Human

# OSM File Here
file_path = FilePath("K:\PostgraduatedWorks\2021 Semester 02\Fork it\Smaller Site Tokyo")
panel = Panel("""railway=stop，
ref=s01,
ref=s02,
ref=s03,
ref=s04,
ref=s05,
ref=s06,
ref=s07,
ref=s08,
ref=s09,
ref=s10,
ref=s11,
ref=s12,
ref=s13,
ref=s14,
ref=s15,
ref=s16,""")
panel_2 = Panel("""railway=stop，
network=都営地下鉄""")
# Scenario  that Only the Toei subway can be used to travel to the designated location.
panel_3 = Panel("""railway=stop，
operator=東京地下鉄""")
panel_4 = Panel("""railway=stop，
network=都営地下鉄""")
extract_nodes = ExtractNodes(OSMFilePath=file_path, OSMFeatures=panel)  # -> Nodes, Tags, Report
extract_nodes_2 = ExtractNodes(OSMFilePath=file_path, OSMFeatures=panel_4)  # -> Nodes, Tags, Report
extract_ways = ExtractWays(OSMFilePath=file_path, OSMFeatures="name:en=Toei Shinjuku Line")  # -> Ways, Tags, Report
extract_ways_2 = ExtractWays(OSMFilePath=file_path, OSMFeatures="name:en=Toei Mita Line")  # -> Ways, Tags, Report
extract_nodes_3 = ExtractNodes(OSMFilePath=file_path, OSMFeatures=panel_2)  # -> Nodes, Tags, Report
extract_nodes_4 = ExtractNodes(OSMFilePath=file_path, OSMFeatures=panel_3)  # -> Nodes, Tags, Report

# ---- group: Subway Entrance points
# Step 01:Data Collecting by Caribou
specify_features = SpecifyFeatures(selectionIncludesObscure=True, selectionSerialised="railway=subway_entrance")
extract_nodes_5 = ExtractNodes(OSMFilePath=file_path, OSMFeatures=specify_features)  # -> Nodes, Tags, Report

# ----
point = Point(extract_nodes.Nodes)

# ----
# Cloest Interchange Platform Running by Different Operators: This is another battery component generating distribution of transport platforms. Grid with circle matrix is used to replace the previous metaball version for representing distribution of transport platforms.
point_2 = Point(graft(extract_nodes_3.Nodes))
point_3 = Point(flatten(extract_nodes_4.Nodes))
# All Toei Mita Line subway stations Passed: All Toei Shinjuku Line subway stations that you will pass through during your trip.
number_slider = Slider(400, range=0..1000)
closest_points = ClosestPoints(Point=point_2, Cloud=point_3, Count=Slider(1, range=0..10))  # -> ClosestPoint, CPIndex, Distance
line = Line(StartPoint=point_2, EndPoint=closest_points.ClosestPoint)  # -> flatten(Line)
smaller_than = SmallerThan(FirstNumber=closest_points.Distance, SecondNumber=number_slider)  # -> flatten(SmallerThan), OrEqualTo
cull_pattern = CullPattern(List=line, CullPattern=smaller_than.SmallerThan)
curve = Curve(cull_pattern)

# ---- group: Entrances Metaball
# Approximate Boundary of Transport Platform Distribution: The approximate distribution of transportation platform identifies the area platforms located. Metaballs represent the distribution of transport platforms (Bus Stops / Ralway Stations / Subway Entrances / Etc.) in the map.
number_slider_2 = Slider(1.9, range=0..10)
# Approximate Subway Entrances Scope (Grid Style): This is another battery component generating distribution of transport platforms. Grid with circle matrix is used to replace the previous metaball version for representing distribution of transport platforms.
number_slider_3 = Slider(400, range=0..1000)
# Step 02: Data Analysing
integer = Integer(number_slider_2)
list_length = ListLength(List=extract_nodes_5.Nodes)
multiplication = Multiplication(A=integer, B=number_slider_3)
repeat_data = RepeatData(Data=multiplication, Length=list_length)
metaball_t_custom = MetaBallTCustom(Points=extract_nodes_5.Nodes, Charge=repeat_data, Plane=PlaneXY(0, 0, 0), Threshold=0.5, Accuracy=Slider(3, range=0..10))

# ---- group: Entrance Density
rectangle = Rectangle({Plane=PlaneXY(3867.972501, 5460.33652, 0), Size=Domain2(u=-3786.128419..3786.128419, v=-4635.036137..4635.036137)})
curve_2 = Curve(metaball_t_custom)
integer_2 = Integer(Slider(70, range=0..100))
field_mapper = FieldMapper(Bounds=rectangle, Divisions=integer_2, Areas=curve_2, ZRange=0)
integer_3 = Integer(Slider(7, range=0..100))
integer_4 = Integer(Slider(54, range=0..100))
field_visualisation_grid = FieldVisualisationGrid(Field=field_mapper, Bounds=rectangle, DomainStart=integer_3, DomainEnd=integer_4)  # -> Points, Parameters
circle_cnr = CircleCNR(Center=field_visualisation_grid.Points, Normal=Vector(0, 0, 1), Radius=field_visualisation_grid.Parameters)
geometry = Geometry(circle_cnr)

# ----
point_4 = Point(extract_nodes.Nodes)
proximity_2d = Proximity2D(Points=point_4, Plane=PlaneXY(0, 0, 0), Group=5, MaxRadius=Slider(200, range=0..1000))  # -> Links, Topology
curve_3 = Curve(proximity_2d.Links)
join_curves = JoinCurves(Curves=curve_3, Preserve=Toggle(False))  # -> flatten(Curves)
polygon_center = PolygonCenter(Polyline=join_curves)  # -> CenterV, CenterE, CenterA
point_5 = Point(polygon_center.CenterV)
cull_duplicates = CullDuplicates(Points=point_5, Tolerance=0.1, CullMode=3)  # -> Points, Indices, Valence
series = Series(Start=Slider(0, range=0..100), Step=Slider(1, range=0..10), Count=Slider(5, range=0..10))
list_item = ListItem(List=cull_duplicates.Points, Index=series, Wrap=True)
point_6 = Point(list_item)

# ---- group: Set Destination (End Point)
# All Toei Mita Line subway stations Passed: All Toei Mita Line subway stations that you will pass through during your trip.
extract_ways_3 = ExtractWays(OSMFilePath=file_path, OSMFeatures="name:en=Imperial Palace")  # -> Ways, Tags, Report
point_on_curve = PointOnCurve(extract_ways_3.Ways, parameter=0.613)
east_gate_of_imperial_palace = Point(point_on_curve)

# ----
curve_4 = Curve(extract_ways_2.Ways)
point_7 = Point(extract_nodes_2.Nodes)
curve_closest_point = CurveClosestPoint(Point=point_7, Curve=graft(curve_4))  # -> Point, Parameter, Distance
smaller_than_2 = SmallerThan(FirstNumber=curve_closest_point.Distance, SecondNumber=Slider(377, range=0..1000))  # -> SmallerThan, OrEqualTo
cull_pattern_2 = CullPattern(List=point_7, CullPattern=smaller_than_2.SmallerThan)
point_8 = Point(flatten(cull_pattern_2))
point_9 = Point(east_gate_of_imperial_palace)
circle_cnr_2 = CircleCNR(Center=point_9, Normal=Vector(0, 0, 1), Radius=Slider(1555, range=0..10000))
cull_duplicates_2 = CullDuplicates(Points=point_8, Tolerance=0.1, CullMode=3)  # -> Points, Indices, Valence
curve_5 = Curve(circle_cnr_2)
point_in_curves = PointInCurves(Point=cull_duplicates_2.Points, Curves=curve_5)  # -> Relationship, Index, Point
point_10 = Point(cull_duplicates_2.Points)
dispatch = Dispatch(List=point_10, DispatchPattern=point_in_curves.Relationship)  # -> ListA, ListB
point_11 = Point(dispatch.ListA)
proximity_2d_2 = Proximity2D(Points=point_11, Plane=PlaneXY(0, 0, 0), Group=5, MaxRadius=Slider(50, range=0..100))  # -> Links, Topology
join_curves_2 = JoinCurves(Curves=proximity_2d_2.Links, Preserve=False)
polygon_center_2 = PolygonCenter(Polyline=join_curves_2)  # -> CenterV, CenterE, CenterA
point_12 = Point(flatten(polygon_center_2.CenterV))
cull_duplicates_3 = CullDuplicates(Points=point_12, Tolerance=0.1, CullMode=3)  # -> Points, Indices, Valence
series_2 = Series(Start=Slider(0, range=0..100), Step=Slider(1, range=0..10), Count=Slider(2, range=0..10))
panel_5 = Panel(cull_duplicates_3.Points)
sort_points = SortPoints(Points=cull_duplicates_3.Points)  # -> Points, Indices
list_item_2 = ListItem(List=reverse(sort_points.Points), Index=series_2, Wrap=True)
point_13 = Point(list_item_2)

# ---- group: Subway Route 02
point_14 = Point(point_13)

# ---- group: East Gate of Imperial Palace
imperial = Point(east_gate_of_imperial_palace)

# ----
subway_route_01 = Point(point_6)
polyline = PolyLine(Vertices=[subway_route_01, point_14], Closed=False)
# Final Route Stimulation: A animation stimulating movement of a traveler generated here. The component set a scenario that the traveler moves to the east gate of the Imperial Palace by taking Toei subway (Specific Operator) only.
end_points = EndPoints(Curve=polyline)  # -> Start, End
point_15 = Point(end_points.End)
line_2 = Line(StartPoint=point_15, EndPoint=imperial)

extract_ways_4 = ExtractWays(OSMFilePath=file_path, OSMFeatures=panel_3)  # -> Ways, Tags, Report
curve_6 = Curve(extract_ways_4.Ways)
custom_preview_lineweights = CustomPreviewLineweights(Geometry=curve_6, Shader=ColourSwatch(SwatchColor=RGB(117, 117, 117)), Absolute=False)

extract_ways_5 = ExtractWays(OSMFilePath=file_path, OSMFeatures=panel_2)  # -> Ways, Tags, Report
curve_7 = Curve(extract_ways_5.Ways)
custom_preview_lineweights_2 = CustomPreviewLineweights(Geometry=curve_7, Shader=ColourSwatch(SwatchColor=RGB(209, 209, 209)), Thickness=Slider(1, range=0..1), Absolute=False)

curve_8 = Curve(curve)
number_slider_4 = Slider(48, range=0..100)
end_points_2 = EndPoints(Curve=curve_8)  # -> Start, End
custom_preview_lineweights_3 = CustomPreviewLineweights(Geometry=curve_8, Shader=ColourSwatch(SwatchColor=RGB(102, 168, 255)), Thickness=Slider(3, range=0..100), Absolute=False)
dot_display = DotDisplay(Point=end_points_2.Start, Colour=ColourSwatch(SwatchColor=RGB(255, 110, 131)), Size=number_slider_4)
dot_display_2 = DotDisplay(Point=end_points_2.End, Colour=ColourSwatch(SwatchColor=RGB(246, 207, 255)), Size=number_slider_4)

# ---- group: Movement to End Point Animation
# Subway Travel Stimulation Here
join_curves_3 = JoinCurves(Curves=[polyline, line_2], Preserve=False)
point_on_curve_2 = PointOnCurve(join_curves_3, parameter=1)
polygon = Polygon(Plane=point_on_curve_2, Radius=Slider(131, range=0..150), Segments=Slider(5, range=0..10), FilletRadius=0)  # -> Polygon, Length
boundary_surfaces = BoundarySurfaces(Edges=polygon.Polygon)
custom_preview = CustomPreview(Geometry=boundary_surfaces, Material=ColourSwatch(SwatchColor=RGB(69, 177, 255)))

# ---- group: Subway Line 02
custom_preview_2 = CustomPreview(Geometry=extract_ways_2.Ways, Material=ColourSwatch(SwatchColor=RGB(140, 140, 140)))

# ---- group: Subway Line 01
custom_preview_3 = CustomPreview(Geometry=extract_ways.Ways, Material=ColourSwatch(SwatchColor=RGB(207, 207, 207)))

# ---- group: Imperial Palace Boundary
custom_preview_lineweights_4 = CustomPreviewLineweights(
    Geometry=extract_ways_3.Ways,
    Shader=ColourSwatch(SwatchColor=RGB(255, 255, 255)),
    Thickness=Slider(4, range=0..100),
    Absolute=False)

# ---- group: Destination
dot_display_3 = DotDisplay(Point=imperial, Colour=ColourSwatch(SwatchColor=RGB(115, 255, 218)), Size=Slider(90, range=0..100))

# ---- group: All Stops running by Toei Shinjuku Line
dot_display_4 = DotDisplay(Point=cull_duplicates.Points, Colour=ColourSwatch(SwatchColor=RGB(245, 147, 20)), Size=Slider(78, range=0..100))

# ----
deconstruct = Deconstruct()  # -> XComponent, YComponent, ZComponent
sort_list = SortList()  # -> Keys, ValuesValuesA
smaller_than_3 = SmallerThan(FirstNumber=deconstruct.YComponent, SecondNumber=Slider(5548, range=0..10000))  # -> SmallerThan, OrEqualTo
panel_6 = Panel(sort_list.ValuesValuesA)
dispatch_2 = Dispatch(List=sort_list.ValuesValuesA, DispatchPattern=smaller_than_3.SmallerThan)  # -> ListA, ListB
construct_domain = ConstructDomain(DomainStart=Slider(0, range=0..100), DomainEnd=1)
includes = Includes(Value=sort_list.ValuesValuesA, Domain=construct_domain)  # -> Includes, Deviation
point_16 = Point(dispatch_2.ListA)
cull_pattern_3 = CullPattern(List=point_16, CullPattern=includes.Includes)
list_item_3 = ListItem(List=includes.Includes, Index=Toggle(False), Wrap=True)
panel_7 = Panel(includes.Includes)
panel_8 = Panel(list_item_3)

geometry_2 = Geometry(geometry)
custom_preview_4 = CustomPreview(Geometry=geometry_2, Material=graft(ColourSwatch(SwatchColor=RGB(34, 106, 112))))

# ----
# Step 03: Visualization
number_slider_5 = Slider(3, range=0..10)
curve_9 = Curve(metaball_t_custom)
custom_preview_lineweights_5 = CustomPreviewLineweights(Geometry=curve_9, Shader=ColourSwatch(SwatchColor=RGB(136, 93, 201)), Thickness=number_slider_5, Absolute=False)

polygon_2 = Polygon(Plane=PlaneXY(0, 0, 0), Radius=Slider(70, range=0..100), Segments=Slider(4, range=0..10), FilletRadius=0)  # -> Polygon, Length
boundary_surfaces_2 = BoundarySurfaces(Edges=polygon_2.Polygon)
custom_preview_5 = CustomPreview(Geometry=boundary_surfaces_2, Material=ColourSwatch(SwatchColor=RGB(217, 122, 39)))

curve_10 = Curve()
join_curves_4 = JoinCurves(Curves=curve_10, Preserve=False)
list_item_4 = ListItem(List=join_curves_4, Index=Slider(0, range=0..100), Wrap=True)
point_on_curve_3 = PointOnCurve(list_item_4, parameter=0.444)
point_17 = Point(point_on_curve_3)
deconstruct_2 = Deconstruct(Point=point_17)  # -> XComponent, YComponent, ZComponent
panel_9 = Panel(deconstruct_2.YComponent)

dot_display_5 = DotDisplay(Point=point_7, Colour=ColourSwatch(SwatchColor=RGB(168, 168, 168)), Size=Slider(60, range=0..100))
