# Grasshopper definition Shortest Path Gilded by Unpanitrable Boundary.gh (Grasshopper 1.0.7)
# plug-ins: Caribou, Groundhog

# ----
# OSM Features as Starting Points
specify_features = SpecifyFeatures(selectionIncludesObscure=True)
extract_nodes = ExtractNodes(OSMFeatures=specify_features)  # -> Nodes, Tags, Report

# ----
# Places that travellers
# try to avoid.
# Road networks for
# path analysis
specify_features_2 = SpecifyFeatures(
    selectionIncludesObscure=True,
    selectionSerialised="highway=give_way,highway=living_street,highway=passing_place,highway=primary,highway=primary_link,highway=raceway,highway=residential,highway=rest_area,highway=road,highway=secondary,highway=secondary_link,highway=service,highway=turning_loop,highway=unclassified")
specify_features_3 = SpecifyFeatures(selectionIncludesObscure=True, selectionSerialised="historic=*")
# OSM File Here
file_path = FilePath("K:\PostgraduatedWorks\2021 Semester 02\Fork it\Nairobi 2")
extract_ways = ExtractWays(OSMFilePath=file_path, OSMFeatures=specify_features_2)  # -> Ways, Tags, Report
extract_nodes_2 = ExtractNodes(OSMFilePath=file_path, OSMFeatures=specify_features_3)  # -> Nodes, Tags, Report

# ----
# This Metaball is representing the boundary of places that visitor may not want to pass through.
point = Point([<point referenced from the Rhino model> x13])

# ---- group: Test Points
# Sorting starting points by distance
point_2 = Point([<point referenced from the Rhino model> x6])

# ----
number_slider = Slider(1000, range=0..1000)
point_3 = Point(point)
list_length = ListLength(List=point_3)
multiplication = Multiplication(A=Slider(2, range=0..10), B=Slider(10000, range=0..10000))
repeat_data = RepeatData(Data=multiplication, Length=list_length)
metaball_t_custom = MetaBallTCustom(Points=point_3, Charge=repeat_data, Plane=PlaneXY(0, 0, 0), Threshold=0.5)

curve = Curve([<curve referenced from the Rhino model> x16])

# ---- group: Split all Curves at Intersections (from open source)
# Thanks to user Systemiq on the (old) Grasshopper forums http://www.grasshopper3d.com/forum/topics/split-curve-s-by-intersection-with-other-curve-s
intersect_all = IntersectAll(crv=curve)

# ----
curve_2 = Curve(graft(intersect_all))
curve_3 = Curve(metaball_t_custom)
curve_4 = Curve(curve_2)

curve_closest_point = CurveClosestPoint(Point=point_2, Curve=curve_4)  # -> Point, Parameter, Distance
point_4 = Point(curve_closest_point.Point)
distance = Distance(PointA=point_2, PointB=point_4)
smaller_than = SmallerThan(FirstNumber=distance, SecondNumber=Slider(600, range=0..10000))  # -> SmallerThan, OrEqualTo
cull_pattern = CullPattern(List=point_4, CullPattern=smaller_than.SmallerThan)
point_5 = Point(cull_pattern)

# ----
# Collision Test to find roads intersecting with impenetrable boundaries.
collision_one_many = CollisionOneMany(Collider=curve_2, Obstacles=curve_3)  # -> Collision, Index
cull_pattern_2 = CullPattern(List=curve_2, CullPattern=invert(collision_one_many.Collision))

# ---- group: Suppoesd Starting points
point_6 = Point(point_5)

# ----
curve_5 = Curve(cull_pattern_2)
curve_6 = Curve(curve_5)

# ----
# The Closest endpoints from the strating points on curves
end_points = EndPoints(Curve=curve_6)  # -> Start, End
point_7 = Point(flatten(end_points.End))
point_8 = Point(graft(point_6))
distance_2 = Distance(PointA=point_7, PointB=point_8)
smaller_than_2 = SmallerThan(FirstNumber=distance_2, SecondNumber=Slider(75, range=0..10000))  # -> SmallerThan, OrEqualTo
cull_pattern_3 = CullPattern(List=point_7, CullPattern=smaller_than_2.SmallerThan)

# ----
# OSM Features as End Points
specify_features_4 = SpecifyFeatures(selectionIncludesObscure=True)
extract_nodes_3 = ExtractNodes(OSMFeatures=specify_features_4)  # -> Nodes, Tags, Report

curve_7 = Curve(flatten(curve_6))
end_points_2 = EndPoints(Curve=curve_7)  # -> Start, End
point_9 = Point(end_points_2.End)
end_points_3 = Point([<point referenced from the Rhino model> x2])
closest_points = ClosestPoints(Point=end_points_3, Cloud=point_9, Count=Slider(6, range=0..100))  # -> ClosestPoint, CPIndex, Distance
cull_duplicates = CullDuplicates(Points=closest_points.ClosestPoint, Tolerance=0.1, CullMode=3)  # -> Points, Indices, Valence
point_10 = Point(graft(cull_duplicates.Points))

curve_8 = Curve(curve_6)
point_11 = Point(flatten(cull_pattern_3))
curve_9 = Curve(flatten(curve_8))

# ----
# The Shortest Path Series as Result
shortest_path = ShortestPath(Curves=curve_9, Starts=point_11, Ends=point_10)  # -> ShortestPath, Succession, Direction, Length
curve_10 = Curve(flatten(shortest_path.ShortestPath))
clean_tree = CleanTree(RemoveNulls=True, RemoveInvalid=True, RemoveEmpty=False, Tree=curve_10)

list_item = ListItem(List=clean_tree, Index=Slider(761, range=0..1000), Wrap=True)
panel = Panel("optimize running speed")
curve_11 = Curve(list_item)

curve_12 = Curve(clean_tree)
reduce = Reduce(Polyline=curve_12, Tolerance=Slider(10, range=0..10))  # -> Polyline, Reduction

control_points = ControlPoints(Curve=reduce.Polyline)  # -> Points, Weights, Knots

# ----
# Rebuild Shortest Path to more smooth curve + Move curves randomly to generate different width for visualization
# Visualization
number_slider_2 = Slider(-22, range=-25..50)
deconstruct = Deconstruct(Point=control_points.Points)  # -> XComponent, YComponent, ZComponent
construct_domain = ConstructDomain(DomainStart=graft(number_slider_2), DomainEnd=Slider(25, range=0..100))
list_length_2 = ListLength(List=flatten(deconstruct.YComponent))
list_length_3 = ListLength(List=flatten(deconstruct.XComponent))
random = Random(Range=construct_domain, Number=list_length_2, Seed=2)
random_2 = Random(Range=construct_domain, Number=list_length_3, Seed=Slider(47, range=0..100))
unflatten_tree = UnflattenTree(Tree=random, Guide=deconstruct.YComponent)
unflatten_tree_2 = UnflattenTree(Tree=random_2, Guide=deconstruct.XComponent)
addition = Addition(A=deconstruct.YComponent, B=unflatten_tree)
addition_2 = Addition(A=deconstruct.XComponent, B=unflatten_tree_2)
construct_point = ConstructPoint(XCoordinate=addition_2, YCoordinate=addition, ZCoordinate=0)
polyline = PolyLine(Vertices=construct_point, Closed=False)
rebuild_curve = RebuildCurve(Curve=polyline, Degree=Slider(3, range=0..10), Count=Slider(12, range=0..100), Tangents=False)

# ==== cluster IntersectAll
crv = ClusterInput()
# Thanks to user Systemiq on the (old) Grasshopper forums http://www.grasshopper3d.com/forum/topics/split-curve-s-by-intersection-with-other-curve-s
crv_2 = Curve(reparameterize(flatten(crv)))
lng = ListLength(List=crv_2)
mcx = MultipleCurves(Curves=crv_2)  # -> Points, IndexA, IndexB, ParamA, ParamB
series = Series(Start=0, Step=1, Count=lng)
int = Integer(series)
mindex = MemberIndex(Set=[mcx.IndexA, mcx.IndexB], Member=int)  # -> Index, Count
pshift = ShiftPaths(Data=mindex.Index, Offset=-1)
number_slider = Slider(0.0001, range=1e-05..0.1)
item = ListItem(List=[mcx.ParamA, mcx.ParamB], Index=pshift, Wrap=True)
unflatten = UnflattenTree(Tree=item, Guide=mindex.Index)
cset = CreateSet(List=unflatten)  # -> Set, Map
larger = LargerThan(FirstNumber=cset.Set, SecondNumber=expr("1-x", number_slider))  # -> LargerThan, OrEqualTo
smaller = SmallerThan(FirstNumber=cset.Set, SecondNumber=number_slider)  # -> SmallerThan, OrEqualTo
or = GateOr(A=smaller.SmallerThan, B=larger.LargerThan)
cull = CullPattern(List=cset.Set, CullPattern=invert(or))
vb = VBScript(x=cull)  # -> out, A
# ---------- vb: VB ----------
    If x Is Nothing Then
      a = nothing
    Else
      a = x
    End If
# ---------- end vb ----------
shatter = Shatter(Curve=graft(crv_2), Parameters=vb.A)  # -> simplify(Segments)
curve = Curve(flatten(shatter))
curve_2 = ClusterOutput(curve)
